# Grasshopper definition semi automated crop field drawings v1.gh (Grasshopper 1.0.7)
# plug-ins: Human

panel = Panel("""00
01
02
03
04
05
06
07
08
09""")
series = Series(Start=Slider(10, range=0..10), Step=1, Count=Slider(20, range=0..100))
merge = Merge(Data1=panel, Data2=series)  # -> flatten(Result)
gps_koordintaes = Panel("""55°36'45"N 12°15'43"E
55°31'22"N 11°46'18"E
55°36'00"N 12°02'59"E
55°36'30"N 11°59'54"E
55°40'14"N 11°59'59"E
55°38'46"N 11°58'58"E
55°38'31"N 11°59'37"E
55°36'14"N 12°13'32"E
55°36'05"N 12°04'31"E""")
panel_2 = Panel(merge)
item_selector = ItemSelector(
    panel_2,
    {"00", "01", "02", "03", "04", "05", "06", "07", "08", "09", "10", "11", "12", "13", "14", "15", "16", "17", "18", "19", "20", "21", "22", "23", "24", "25", "26", "27", "28", "29"}, selected="09")

# ----
# LAYER: field peremiter
# field offset
# field NO
# LAYER: startline
# Distance between tracks
panel_3 = Panel("0")
concatenate = Concatenate(A="field ", Fragment_A=panel_3, Fragment_B=item_selector, B=" startline")
radians = Radians(Degrees=Slider(90, range=0..100))
distance_between_tracks = Slider(17.97, range=0..20)
dynamic_geometry_pipeline = DynamicGeometryPipeline(
    LayerFilter=concatenate,
    TypeFilter="All",
    NameFilter="*",
    GroupByLayer=False,
    GroupByType=False,
    IncludeHidden=True,
    IncludeLocked=True,
    enableFullPath=False,
    listenToAttributes=True)
concatenate_2 = Concatenate(A="field ", Fragment_A="0", Fragment_B=item_selector, B=" perimeter")
rotate = Rotate(Geometry=dynamic_geometry_pipeline, Angle=radians, Plane=PlaneXY(0, 0, 0))  # -> Geometry, Transform
multiplication = Multiplication(A=distance_between_tracks, B=Slider(2, range=0..10))
end_points = EndPoints(Curve=rotate.Geometry)  # -> Start, End
series_2 = Series(Start=0, Step=multiplication, Count=Slider(37, range=0..100))
# INSTRUCTIONS:
# A. take screenshot from google earth
# B. measure a distance on googel erath
# C. place image in layer: field xxx image
# D. scale image to 1:1 (meters)
# E. draw perimater on layer XXX perimeter
# F. draw startline on layer XXX startline
# G. check if startline multiplies in correct direction
# H. Adjust grid intervals
# I. Bake curve line to layer XXX baked
# J. Adjust curve linw on XXX baked
# K. Add addtionel cirves on layer XXX Xtra
panel_4 = Panel("All")
dynamic_geometry_pipeline_2 = DynamicGeometryPipeline(
    LayerFilter=concatenate_2,
    TypeFilter=panel_4,
    NameFilter="*",
    GroupByLayer=False,
    GroupByType=False,
    IncludeHidden=True,
    IncludeLocked=True,
    enableFullPath=False,
    listenToAttributes=True)
vector_2pt = Vector2Pt(PointA=end_points.Start, PointB=end_points.End, Unitize=False)  # -> Vector, Length
negative = Negative(Value=Slider(13, range=0..50))
# change direction of grid lines if necessary
reverse = Reverse(Vector=vector_2pt.Vector)
# Perimeter offset
# to be baked to
# layer XXX Xtra
offset_curve = OffsetCurve(Curve=dynamic_geometry_pipeline_2, Distance=negative, Corners=1)
amplitude = Amplitude(Vector=vector_2pt.Vector, Amplitude=series_2)
# preview grid lines
move = Move(Geometry=dynamic_geometry_pipeline, Motion=amplitude)  # -> Geometry, Transform

# ----
# DEFALUT VALUE IS : 8
number_slider = Slider(8, range=0..100)

# ----
# LAYER: baked
panel_5 = Panel("0")
concatenate_3 = Concatenate(Fragment_A="field ", Fragment_B=panel_5, A=item_selector, B=" baked")
dynamic_geometry_pipeline_3 = DynamicGeometryPipeline(
    LayerFilter=concatenate_3,
    TypeFilter="All",
    NameFilter="*",
    GroupByLayer=False,
    GroupByType=False,
    IncludeHidden=True,
    IncludeLocked=True,
    enableFullPath=False,
    listenToAttributes=True)
number_slider_2 = Slider(2, range=0..10)
fillet = Fillet(Curve=dynamic_geometry_pipeline_3, Radius=number_slider)
negative_2 = Negative(Value=number_slider_2)
# field 004 baked output
offset_curve_2 = OffsetCurve(Curve=fillet, Distance=negative_2, Corners=1)
offset_curve_3 = OffsetCurve(Curve=fillet, Distance=number_slider_2, Corners=1)

# ----
# Points - perimeter/offset startline
# Points - annotation
curve_curve = CurveCurve(CurveA=offset_curve, CurveB=move.Geometry)  # -> Points, ParamsA, ParamsB
panel_6 = Panel("""0
1""")
cull_index = CullIndex(List=flatten(curve_curve.Points), Indices=panel_6, Wrap=True)
list_length = ListLength(List=flatten(curve_curve.Points))
series_3 = Series(Start=0, Step=1, Count=list_length)
screen_oriented_text = ScreenOrientedText(
    Text=series_3,
    Justification=7,
    Location=flatten(curve_curve.Points),
    SizeFactor=Slider(16, range=0..100),
    Color=ColourSwatch(SwatchColor=RGB(255, 255, 255)),
    Depth=0,
    Absolute=False)

# ----
# Higlight track line
# Trackline to be baked to layer XXX baked
panel_7 = Panel(list_length)
series_4 = Series(Start=0, Step=1, Count=panel_7)
partition_list = PartitionList(List=series_4, Size=Slider(4, range=0..10))
list_item = ListItem(List=partition_list, Index=0, Wrap=True)  # -> Item, Item1, Item2, Item3
merge_2 = Merge(Data1=list_item.Item, Data2=list_item.Item1, Data3=list_item.Item3, Data4=list_item.Item2)  # -> flatten(Result)
list_item_2 = ListItem(List=flatten(curve_curve.Points), Index=merge_2, Wrap=True)
polyline = PolyLine(Vertices=list_item_2, Closed=False)
custom_preview_lineweights = CustomPreviewLineweights(
    Geometry=polyline,
    Shader={diffuse=RGB(255, 105, 180), emission=RGB(76, 32, 54), shine=0.5, specular=RGB(255, 255, 255), transparency=0},
    Thickness=Slider(3, range=0..10),
    Absolute=False)

# ----
# Stiplet line lenght (random interval)
number_slider_3 = Slider(14, range=0..20)
construct_domain = ConstructDomain(DomainStart=Slider(0, range=0..10), DomainEnd=Slider(15, range=0..15))
# distance between points
number_slider_4 = Slider(10, range=0..20)
division = Division(A=number_slider_4, B=number_slider_3)
division_2 = Division(A=number_slider_4, B=Slider(4, range=0..10))
# Radnom seed generator
random = Random(Range=construct_domain, Number=Slider(4, range=0..10), Seed=Slider(9, range=0..10))
subtraction = Subtraction(A=number_slider_4, B=division_2)
construct_domain_2 = ConstructDomain(DomainStart=division, DomainEnd=subtraction)
list_item_3 = ListItem(List=random, Index=0, Wrap=True)  # -> Item, Item1, Item2, Item3
number_slider_5 = Slider(7, range=0..25)
# Larger spacing
construct_domain_3 = ConstructDomain(DomainStart=Slider(30, range=0..100), DomainEnd=Slider(69, range=0..100))
random_2 = Random(Range=construct_domain_3, Number=Slider(3, range=0..10), Seed=2)
number_slider_6 = Slider(20, range=0..100)
# Line lenghts
number_slider_7 = Slider(1, range=0..100)
# Spacing lenghts
number_slider_8 = Slider(2, range=0..100)
# Amount of long white spaces (22 is default)
number_slider_9 = Slider(22, range=0..100)
# Spacing lenghts
construct_domain_4 = ConstructDomain(DomainStart=Slider(3, range=0..100), DomainEnd=number_slider_5)
construct_domain_5 = ConstructDomain(DomainStart=number_slider_7, DomainEnd=Slider(4, range=0..10))
# Line lenghts
number_slider_10 = Slider(1, range=0..100)
construct_domain_6 = ConstructDomain(DomainStart=number_slider_8, DomainEnd=number_slider_5)
duplicate_data = DuplicateData(Data=random_2, Number=number_slider_9, Order=True)
random_3 = Random(Range=construct_domain_4, Number=Slider(1000, range=0..1000), Seed=list_item_3.Item)  # -> flatten(Random)
random_4 = Random(Range=construct_domain_5, Number=Slider(1000, range=0..1000), Seed=list_item_3.Item1)
construct_domain_7 = ConstructDomain(DomainStart=number_slider_10, DomainEnd=Slider(4, range=0..10))
random_5 = Random(Range=construct_domain_6, Number=Slider(1000, range=0..1000), Seed=list_item_3.Item1)
merge_3 = Merge(Data1=random_5, Data2=duplicate_data)  # -> flatten(Result)
merge_4 = Merge(Data1=random_3, Data2=duplicate_data)  # -> flatten(Result)
random_6 = Random(Range=construct_domain_7, Number=Slider(1000, range=0..1000), Seed=list_item_3.Item)
jitter = Jitter(List=merge_4, Jitter=1, Seed=2)  # -> Values, Indices
jitter_2 = Jitter(List=merge_3, Jitter=1, Seed=2)  # -> Values, Indices
weave = Weave(Pattern=[0, 1], Stream0=random_6, Stream1=jitter.Values, NullGaps=False)
weave_2 = Weave(Pattern=[0, 1], Stream0=random_4, Stream1=jitter_2.Values, NullGaps=False)
# field 004 baked output
dash_pattern = DashPattern(Curve=offset_curve_2, Pattern=weave)  # -> Dashes, Gaps
dash_pattern_2 = DashPattern(Curve=offset_curve_3, Pattern=weave_2)  # -> Dashes, Gaps
relay = Relay()
list_length_2 = ListLength()
# 10-01-2025: Field 003 v3: 1762 points. Runtime: 20 min
# 
# =  1200 sek
# 
# sepped 25
list_length_3 = ListLength()
concatenate_4 = Concatenate(FragmentA="Main Track points: ", FragmentB=list_length_3)
concatenate_5 = Concatenate(FragmentA="Main Track lenght(in meters): ", FragmentB=relay)
concatenate_6 = Concatenate(FragmentA="Xtra Track points: ", FragmentB=list_length_2)
addition = Addition(A=list_length_3, B=list_length_2)
panel_8 = Panel(concatenate_5)
panel_9 = Panel(concatenate_4)
panel_10 = Panel(concatenate_6)
concatenate_7 = Concatenate(FragmentA="Total points: ", FragmentB=addition)
panel_11 = Panel(concatenate_7)
# 11-01-2025: Field 006 v3: 1091 points. Runtime: 12min 40 sek
# 
# 
# 
# speed 40
# 10-01-2025: Field 003: 5312 points. Runtime: 42 min
# 
# =  2520 sek
# 
# 2520/5312 =  0,47 points pr sek
# 
# speed 25
panel_12 = Panel("spped 40")

# ----
# LAYER: Xtra
panel_13 = Panel(" Xtra")
concatenate_8 = Concatenate(Fragment_A="field ", Fragment_B="0", A=item_selector, B=panel_13)
dynamic_geometry_pipeline_4 = DynamicGeometryPipeline(
    LayerFilter=concatenate_8,
    TypeFilter="All",
    NameFilter="*",
    GroupByLayer=False,
    GroupByType=False,
    IncludeHidden=True,
    IncludeLocked=True,
    enableFullPath=False,
    listenToAttributes=True)
number_slider_11 = Slider(2, range=0..10)
fillet_2 = Fillet(Curve=dynamic_geometry_pipeline_4, Radius=number_slider)
negative_3 = Negative(Value=number_slider_11)

clean_tree = CleanTree(RemoveNulls=True, RemoveInvalid=True, RemoveEmpty=invert(False), Tree=fillet_2)  # -> graft(Tree)

offset_curve_4 = OffsetCurve(Curve=clean_tree, Distance=negative_3, Corners=1)
offset_curve_5 = OffsetCurve(Curve=clean_tree, Distance=number_slider_11, Corners=1)

clean_tree_2 = CleanTree(RemoveNulls=True, RemoveInvalid=True, RemoveEmpty=invert(False), Tree=offset_curve_5)
# field 004 Xtra output
clean_tree_3 = CleanTree(RemoveNulls=True, RemoveInvalid=True, RemoveEmpty=invert(False), Tree=offset_curve_4)
panel_14 = Panel(clean_tree_3)
# field 004 Xtra output
dash_pattern_3 = DashPattern(Curve=clean_tree_3, Pattern=weave)  # -> Dashes, Gaps
dash_pattern_4 = DashPattern(Curve=clean_tree_2, Pattern=weave_2)  # -> Dashes, Gaps
# Mute this preview before export
merge_5 = Merge(Data1=dash_pattern.Dashes, Data2=dash_pattern_2.Dashes, Data3=dash_pattern_3.Dashes, Data4=dash_pattern_4.Dashes)
flatten_tree = FlattenTree(Tree=clean_tree, Path="{0}")
length = Length(Curve=flatten_tree)
mass_addition = MassAddition(Input=length)  # -> Result, PartialResults
concatenate_9 = Concatenate(FragmentA="Xtra Track lenght(meters): ", FragmentB=mass_addition.Result)
addition_2 = Addition(A=relay, B=mass_addition.Result)
panel_15 = Panel(concatenate_9)
concatenate_10 = Concatenate(FragmentA="Total lenght meters: ", FragmentB=addition_2)
# 10-01-2025: Field 001: 3108 points. Runtime: 70 min
panel_16 = Panel(concatenate_10)
